# Dynamo graph EC2 Vol concreto.dyn (Dynamo 3.6.2.11575)

file_path = Filename("..\ec2\Volumen de concreto.xlsx")
string = StringInput("Vol")  # graph input
categories = Categories("OST_StructuralColumns")
all_elements_of_category = ElementsOfCategory(Category=categories)
categories_2 = Categories("OST_StructuralFraming")
all_elements_of_category_2 = ElementsOfCategory(Category=categories_2)
categories_3 = Categories("OST_Floors")
all_elements_of_category_3 = ElementsOfCategory(Category=categories_3)
join = List.Join(list0=all_elements_of_category, list1=all_elements_of_category_2, list2=all_elements_of_category_3)
python_script = Python(IN[0]=join)  # CPython3
# ---------- python_script.python (319 lines) ----------
import clr

# =========================================================
# REFERENCIAS
# =========================================================

clr.AddReference('RevitServices')
from RevitServices.Persistence import DocumentManager

clr.AddReference('RevitAPI')
from Autodesk.Revit.DB import *


# =========================================================
# DOCUMENTO ACTUAL
# =========================================================

doc = DocumentManager.Instance.CurrentDBDocument


# =========================================================
# ENTRADA DE DYNAMO
# =========================================================

entrada = IN[0]

if not isinstance(entrada, list):
    entrada = [entrada]


# =========================================================
# FUNCIÓN PARA APLANAR LISTAS
# =========================================================

def aplanar(lista):

    resultado = []

    for elemento in lista:

        if isinstance(elemento, list):
            resultado.extend(aplanar(elemento))

        else:
            resultado.append(elemento)

    return resultado


entrada = aplanar(entrada)


# =========================================================
# CONVERTIR ELEMENTOS DE DYNAMO A REVIT
# =========================================================

elementos = []

for e in entrada:

    elemento = UnwrapElement(e)

    if elemento is not None:
        elementos.append(elemento)


# =========================================================
# IDs DE CATEGORÍAS
# =========================================================

ID_COLUMNAS = ElementId(
    BuiltInCategory.OST_StructuralColumns
).Value

ID_VIGAS = ElementId(
    BuiltInCategory.OST_StructuralFraming
).Value

ID_PISOS = ElementId(
    BuiltInCategory.OST_Floors
).Value


# =========================================================
# FUNCIÓN PARA OBTENER EL NIVEL
# =========================================================

def obtener_nivel(el):

    if el.Category is None:
        return ""


    categoria_id = el.Category.Id.Value


    # -----------------------------------------------------
    # COLUMNAS
    # -----------------------------------------------------

    if categoria_id == ID_COLUMNAS:

        parametro = el.get_Parameter(
            BuiltInParameter.FAMILY_LEVEL_PARAM
        )


    # -----------------------------------------------------
    # VIGAS
    # -----------------------------------------------------

    elif categoria_id == ID_VIGAS:

        parametro = el.get_Parameter(
            BuiltInParameter.INSTANCE_REFERENCE_LEVEL_PARAM
        )


    # -----------------------------------------------------
    # PISOS / LOSAS
    # -----------------------------------------------------

    elif categoria_id == ID_PISOS:

        parametro = el.get_Parameter(
            BuiltInParameter.LEVEL_PARAM
        )


    else:

        parametro = None


    # -----------------------------------------------------
    # OBTENER NOMBRE DEL NIVEL
    # -----------------------------------------------------

    if parametro:

        nivel_id = parametro.AsElementId()

        if nivel_id != ElementId.InvalidElementId:

            nivel = doc.GetElement(nivel_id)

            if nivel:
                return nivel.Name


    return ""


# =========================================================
# FUNCIÓN PARA OBTENER VOLUMEN
# =========================================================

def obtener_volumen(el):

    parametro = el.get_Parameter(
        BuiltInParameter.HOST_VOLUME_COMPUTED
    )


    if parametro:

        volumen_ft3 = parametro.AsDouble()


        # Conversión de pies cúbicos a metros cúbicos

        volumen_m3 = volumen_ft3 * 0.028316846592


        return round(volumen_m3, 3)


    return 0


# =========================================================
# CREAR TABLA
# =========================================================

tabla = []


# =========================================================
# ENCABEZADOS
# =========================================================

tabla.append([

    "Categoría",
    "Tipo",
    "Nivel",
    "Id",
    "Volumen (m3)"

])


# =========================================================
# RECORRER ELEMENTOS
# =========================================================

for el in elementos:

    if el is None:
        continue


    # -----------------------------------------------------
    # COMPROBAR CATEGORÍA
    # -----------------------------------------------------

    if el.Category is None:
        continue


    categoria_id = el.Category.Id.Value


    # -----------------------------------------------------
    # SOLO COLUMNAS, VIGAS Y PISOS
    # -----------------------------------------------------

    if categoria_id not in [

        ID_COLUMNAS,
        ID_VIGAS,
        ID_PISOS

    ]:

        continue


    # -----------------------------------------------------
    # CATEGORÍA
    # -----------------------------------------------------

    categoria = el.Category.Name


    # -----------------------------------------------------
    # TIPO
    # -----------------------------------------------------

    tipo = doc.GetElement(
        el.GetTypeId()
    )


    nombre_tipo = ""


    if tipo:

        parametro_nombre = tipo.get_Parameter(
            BuiltInParameter.SYMBOL_NAME_PARAM
        )


        if parametro_nombre:

            nombre_tipo = parametro_nombre.AsString()


        else:

            nombre_tipo = tipo.Name


    # -----------------------------------------------------
    # NIVEL
    # -----------------------------------------------------

    nivel = obtener_nivel(el)


    # -----------------------------------------------------
    # ID
    # -----------------------------------------------------

    id_elemento = el.Id.Value


    # -----------------------------------------------------
    # VOLUMEN
    # -----------------------------------------------------

    volumen = obtener_volumen(el)


    # -----------------------------------------------------
    # AGREGAR FILA
    # -----------------------------------------------------

    tabla.append([

        categoria,

        nombre_tipo,

        nivel,

        id_elemento,

        volumen

    ])


# =========================================================
# SALIDA
# =========================================================

OUT = tabla
# ----------------------------------------
watch = Watch(python_script)
openXMLExportExcel = Data.OpenXMLExportExcel(filePath=file_path, sheetName=string, data=watch)  # graph output
